# Grasshopper definition build.gh (Grasshopper 1.0.7)
# plug-ins: Firefly.X

geo = Geometry(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)

timer = Timer(TimerInterval=20, Target=[udp_listener, udp_sender])
udp_listener = UDPListener(Port="5005")

len = TextLength(Text=udp_listener)
equals = Equality(FirstNumber=len, SecondNumber=0)  # -> Equality, Inequality
dispatch = Dispatch(List=udp_listener, DispatchPattern=equals.Inequality)  # -> ListA, ListB
rec = DataRecorder(dispatch.ListA, DataLimit=-10, RecordData=True)
panel = Panel(rec)

python = GhPythonScript(RUN=Toggle(True), init_geo=geo, udp_in=udp_listener)  # -> out, udp_out; inputs init_geo: Brep
# ---------- python: Python ----------
__author__ = "Ozguc Capunaman"
__version__ = "2019.03.13"

import rhinoscriptsyntax as rs
import time
import os
import scriptcontext as sc

key = "session"

if sc.sticky.has_key(key):
    session = sc.sticky[key]
else:
    session = None

class ghApp():
    def __init__(self):
        self._mainDIR = "C:\\Users\\Ozguc Capunaman\\Documents\\GitHub\\InteractiveDigitalFabrication\\sessions\\"

    def initSlice(self, init_geo, layer_height=1):
        result = []
        plane = rs.PlaneFromPoints((-500,-500,0), (0,-500,0), (-500,0,0))
        planeSrf = rs.AddPlaneSurface(plane, 1000, 1000)
        crv = rs.IntersectBreps(init_geo, planeSrf)
        pts = rs.DivideCurve(crv, resolution)
        result.extend(pts)
        while True:
            vec = rs.CreateVector((0,0,1))
            planeSrf = rs.MoveObject(planeSrf, vec)
            crv = rs.IntersectBreps(init_geo, planeSrf)
            if crv == None:
                break
            else:
                result.append(crv)
        return result
    
    def crv2pts(self, crvList, resolution = 50):
        result = []
        for i in range(len(crvList)):
            pts = rs.DivideCurve(crv, resolution)
            result.extend(pts)
        return result
    def pts2xyz(self, pts, FN):
        filepath = self._mainDIR+session+"\\"+FN+".xyz"
        if(os.path.exists(filepath)):
            raise Exception('File already exists!')
        else:
            file = open(filepath, "w+")
            for i in range(len(pts)):
                coord = pts[i]
                file.write(str(coord[0]) + " " + str(coord[1]) + " " + str(coord[2]) + "\r\n")
            file.close()
    
    def xyz2pts(self, FN):
        filepath = self._mainDIR+FN+".xyz"
        if(os.path.exists(filepath)):
            result = []
            with open(filepath) as fp:  
               line = fp.readline()
               while line:
                   curLine = line.strip()
                   coord = curLine.split(' ')
                   for i in range(len(coord)):
                       coord[i] = float(coord[i])
                   result.append(rs.AddPoint(coord))
                   line = fp.readline()
            return result
        else:
            raise Exception('File doesn\'t exist!')
    
    def dividePtCloud(self, points):
        ptList = []
        for i in range(len(points)):
            if i == 0:
                tmp = []
            elif i == len(points)-1:
                tmp.append(points[i])
                ptList.append(tmp)
            else:
                tmp.append(points[i])
                _,_,curZ = rs.PointCoordinates(points[i])
                _,_,nextZ = rs.PointCoordinates(points[i+1])
                distZ = curZ - nextZ
                if distZ < 0:
                    ptList.append(tmp)
                    tmp = []
        return ptList

    def createLines(self, ptList, degree = 3, rebuildCount = 10):
        crvList = []
        for i in range(len(ptList)):
             crv = rs.AddCurve(ptList[i])
             rs.RebuildCurve(crv, degree,rebuildCount)
             crvList.append(crv)
        return crvList
        
    def reconSrf(self, crvList):
        return rs.AddLoftSrf(crvList, closed = True)
    
    def decodeMessage(self, udp_in):
        return udp_in.split("_")
    
    def run(self, RUN, udp_in):
        if RUN:
            if udp_in != b'':
                argsList = self.decodeMessage(udp_in)
                if argsList[0] == "+gh":
                    # Handshake with py
                    if argsList[1] == "handshake":
                        time.sleep(.1)
                        session = argsList[2]
                        sc.sticky[key] = session
                        return "-gh_success"
                    elif argsList[1] == "initGeo":
                        # (1)function_(2)resolution_(3)layerheight_(4)filename
                        if init_geo == None:
                            time.sleep(.1)
                            return "-gh_fail_noInitGeo"
                        else:
                            crv = self.initSlice(init_geo, int(argsList[3]))
                            pts = self.crv2pts(crv)
                            self.pts2xyz(pts, argsList[4])
                        time.sleep(.1)
                        return "-gh_success"
                    elif argsList[1] == "func2":
                        time.sleep(.1)
                        return "-gh_done"
        return ""     
app = ghApp()
udp_out = app.run(RUN, udp_in)
# ---------- end python ----------

len_2 = TextLength(Text=python.udp_out)
equals_2 = Equality(FirstNumber=len_2, SecondNumber=0)  # -> Equality, Inequality
dispatch_2 = Dispatch(List=python.udp_out, DispatchPattern=equals_2.Inequality)  # -> ListA, ListB
rec_2 = DataRecorder(dispatch_2.ListA, DataLimit=-10, RecordData=True)
panel_2 = Panel(rec_2)

udp_sender = UDPSender(Data=python.udp_out, IPAddressOfUDPServer="127.0.0.1", UDPPort="5004")

rec_3 = DataRecorder(python.out, DataLimit=-10, RecordData=True)
panel_3 = Panel(rec_3)
