# Grasshopper definition processPointCloud.gh (Grasshopper 1.0.7)
# plug-ins: Volvox

dir = FilePath("C:\Users\Ozguc Capunaman\Documents\GitHub\InteractiveDigitalFabrication\xyz\")
run = Button()
concat = Concatenate(FragmentA=dir, FragmentB="concave", FragmentC=".xyz")
xyzloadex = LoadXyzEx(FilePath=concat, Mask="x y z", Percent=100, Run=run, Abort=False)
decloud = DeconstructCloud(Cloud=xyzloadex)  # -> Points, Normals, Colors
python = GhPythonScript(pts=decloud.Points)  # -> srf, crv; inputs pts: list
# ---------- python: Python ----------
__author__ = "Ozguc Capunaman"
__version__ = "2019.03.09"

import rhinoscriptsyntax as rs


def dividePtCloud(points):
    ptList = []
    for i in range(len(points)):
        if i == 0:
            tmp = []
        elif i == len(points)-1:
            tmp.append(points[i])
            ptList.append(tmp)
        else:
            tmp.append(points[i])
            _,_,curZ = rs.PointCoordinates(points[i])
            _,_,nextZ = rs.PointCoordinates(points[i+1])
            distZ = curZ - nextZ
            if distZ < 0:
                ptList.append(tmp)
                tmp = []
    return ptList

def createLines(ptList, degree = 3, rebuildCount = 10):
    crvList = []
    for i in range(len(ptList)):
         crv = rs.AddCurve(ptList[i])
         rs.RebuildCurve(crv, degree,rebuildCount)
         crvList.append(crv)
    return crvList
    
def reconSrf(crvList):
    return rs.AddLoftSrf(crvList, closed = True)


crv = createLines(dividePtCloud(pts))
srf = reconSrf(crv)
# ---------- end python ----------
